# Grasshopper definition Towers.gh (Grasshopper 1.0.7)
# Copyright: Job de Vogel

shell_offset = Slider(1.8, range=0..10)
levels_per_level = Slider(3, range=0..10)
level_height = Slider(4.2, range=0..10)
grid_size = Slider(7.2, range=0..10)
balcony_depth = Slider(1.8, range=0..10)
levels = Slider(11, range=0..30)
curve = Curve(<curve referenced from the Rhino model>)
curve_2 = Curve(<curve referenced from the Rhino model>)
shell_offset_2 = GetNumber(shell_offset, AtLeast=1, AtMost=1, Maximum=1.797693135e+308, Minimum=-1.797693135e+308)
balcony_depth_2 = GetNumber(balcony_depth, AtLeast=1, AtMost=1, Maximum=1.797693135e+308, Minimum=-1.797693135e+308)
levels_2 = GetNumber(levels, AtLeast=1, AtMost=1, Maximum=1.797693135e+308, Minimum=-1.797693135e+308)
levels_per_level_2 = GetNumber(levels_per_level, AtLeast=1, AtMost=1, Maximum=1.797693135e+308, Minimum=-1.797693135e+308)
ground_floor_rectangle = GetGeometry(AtLeast=1, AtMost=1, DeleteInput=False, Filter=1073741828)
level_height_2 = GetNumber(level_height, AtLeast=1, AtMost=1, Maximum=1.797693135e+308, Minimum=-1.797693135e+308)
grid_size_2 = GetNumber(grid_size, AtLeast=1, AtMost=1, Maximum=1.797693135e+308, Minimum=-1.797693135e+308)
core_rectangle = GetGeometry(AtLeast=1, AtMost=1, DeleteInput=False, Filter=1073741828)
discontinuity = Discontinuity(Curve=ground_floor_rectangle, Level=1)  # -> Points, Parameters
xy_plane = XYPlane(Origin=Point(0, 0, 0))
deconstuct_rectangle = DeconstuctRectangle(Rectangle=ground_floor_rectangle)  # -> BasePlane, XInterval, YInterval
list_item = ListItem(List=discontinuity.Points, Index=0, Wrap=True)
vector_2pt = Vector2Pt(PointA=xy_plane, PointB=list_item, Unitize=False)  # -> Vector, Length
deconstruct_domain = DeconstructDomain(Domain=deconstuct_rectangle.XInterval)  # -> Start, End
deconstruct_domain_2 = DeconstructDomain(Domain=deconstuct_rectangle.YInterval)  # -> Start, End
absolute = Absolute(Value=deconstruct_domain.Start)
absolute_2 = Absolute(Value=deconstruct_domain_2.Start)
addition = Addition(A=absolute, B=deconstruct_domain.End)
addition_2 = Addition(A=absolute_2, B=deconstruct_domain_2.End)
series = Series(Start=0, Step=balcony_depth_2, Count=levels_2)
text = Text(addition)
text_2 = Text(addition_2)
repeat_data = RepeatData(Data=levels_per_level_2, Length=levels_2)
number = Number(text)
number_2 = Number(text_2)
replace_items = ReplaceItems(List=repeat_data, Item="2", Indices="0", Wrap=False)
modulus = Modulus(A=number, B=grid_size_2)
modulus_2 = Modulus(A=number_2, B=grid_size_2)
stack_data = StackData(Data=series, Stack=replace_items)
mass_addition = MassAddition(Input=[modulus_2, modulus])  # -> Result, PartialResults
subtraction = Subtraction(A=addition, B=stack_data)
subtraction_2 = Subtraction(A=addition_2, B=stack_data)
xy_plane_2 = XYPlane(Origin=list_item)
larger_than = LargerThan(FirstNumber=mass_addition.Result, SecondNumber=0)  # -> LargerThan, OrEqualTo
rectangle = Rectangle(Plane=xy_plane_2, XSize=subtraction, YSize=subtraction_2, Radius=0)  # -> Rectangle, Length
stream_filter = StreamFilter(
    Gate=larger_than.LargerThan,
    Stream0="Everything Okay",
    Stream1="WARNING: Ground Floor rectangle domain does not fit in grid size.")
list_length = ListLength(List=rectangle.Rectangle)

# ---- group: RH_OUT:OUT
out = Panel(stream_filter)

# ----
series_2 = Series(Start=level_height_2, Step=level_height_2, Count=list_length)
unit_z = UnitZ(Factor=series_2)
multiplication = Multiplication(A=list_length, B=level_height_2)
move = Move(Geometry=xy_plane_2, Motion=unit_z)  # -> Geometry, Transform
move_2 = Move(Geometry=rectangle.Rectangle, Motion=unit_z)  # -> Geometry, Transform
area = Area(Geometry=move_2.Geometry)  # -> Area, Centroid
partition_list = PartitionList(List=move_2.Geometry, Size=replace_items)
mass_addition_2 = MassAddition(Input=area.Area)  # -> Result, PartialResults
list_item_2 = ListItem(List=partition_list, Index=-1, Wrap=True)  # -> simplify(Item)
deconstuct_rectangle_2 = DeconstuctRectangle(Rectangle=move_2.Geometry)  # -> BasePlane, XInterval, YInterval

# ---- group: RH_OUT:Height
height = Panel(multiplication)

# ---- group: RH_OUT:Area
area_2 = Panel(mass_addition_2.Result)

# ----
unit_z_2 = UnitZ(Factor=multiplication)
offset_curve = OffsetCurve(Curve=list_item_2, Distance=shell_offset_2, Corners=1)  # -> flatten(Curve)
extrude = Extrude(Base=core_rectangle, Direction=unit_z_2)
loft = Loft(Curves=offset_curve, Options={Adjust=False, Closed=False, LoftEnds=0, LoftSimp=0, LoftType=0, Rebuild=10, Refit=0.01})
deconstruct_domain_3 = DeconstructDomain(Domain=deconstuct_rectangle_2.XInterval)  # -> Start, End
deconstruct_domain_4 = DeconstructDomain(Domain=deconstuct_rectangle_2.YInterval)  # -> Start, End
brep_plane = BrepPlane(Brep=extrude, Plane=move.Geometry)  # -> Curves, Points
cap_holes = CapHoles(Brep=extrude)

# ---- group: RH_OUT:Outer Shell
geometry = Geometry(loft)

# ----
absolute_3 = Absolute(Value=deconstruct_domain_3.Start)
absolute_4 = Absolute(Value=deconstruct_domain_4.Start)
surface = Surface(move_2.Geometry)
surface_split = SurfaceSplit(Surface=graft(surface), Curves=brep_plane.Curves)  # -> simplify(Fragments)
addition_3 = Addition(A=absolute_3, B=deconstruct_domain_3.End)
addition_4 = Addition(A=absolute_4, B=deconstruct_domain_4.End)
text_3 = Text(addition_3)
text_4 = Text(addition_4)
number_3 = Number(text_3)
number_4 = Number(text_4)
division = Division(A=number_3, B=grid_size_2)
division_2 = Division(A=number_4, B=grid_size_2)
list_item_3 = ListItem(List=surface_split, Index=0, Wrap=True)
round = Round(Number=division_2)  # -> Nearest, graft(Floor), Ceiling
round_2 = Round(Number=division)  # -> Nearest, graft(Floor), Ceiling

# ---- group: RH_OUT:Floor Surfaces
surface_2 = Surface(list_item_3)

# ---- group: RH_OUT:Core
geometry_2 = Geometry(extrude)

# ----
series_3 = Series(Start=0, Step=grid_size_2, Count=expr("x+1", round_2.Floor))
series_4 = Series(Start=0, Step=grid_size_2, Count=expr("x+1", round.Floor))
cross_reference = CrossReference(ListListA=series_3, ListListB=series_4, CrossMode=1)  # -> ListListA, ListListB
construct_point = ConstructPoint(XCoordinate=cross_reference.ListListA, YCoordinate=cross_reference.ListListB, ZCoordinate=0)  # -> simplify(Point)
move_3 = Move(Geometry=construct_point, Motion=vector_2pt.Vector)  # -> simplify(Geometry), Transform
move_4 = Move(Geometry=move_3.Geometry, Motion=graft(unit_z))  # -> simplify(Geometry), Transform
unit_z_3 = UnitZ(Factor=1)
negative = Negative(Value=unit_z_3)
point_in_brep = PointInBrep(Brep=cap_holes, Point=move_4.Geometry, Strict=False)
cull_pattern = CullPattern(List=move_4.Geometry, CullPattern=invert(point_in_brep))
line_sdl = LineSDL(Start=cull_pattern, Direction=negative, Length=level_height_2)  # -> flatten(Line)
join_curves = JoinCurves(Curves=line_sdl, Preserve=False)

# ---- group: RH_OUT:Points
point = Point(cull_pattern)

# ---- group: RH_OUT:Columns
curve_3 = Curve(join_curves)
